# Dynamo graph OTTV Calculation - NAMS.dyn (Dynamo 2.19.3.6394)
# author: NAMS
# This Dynamo script automates the calculation of the Overall Thermal Transfer Value (OTTV) for building facades based on MS 1525:2019 and MGBC 2016 guidelines.

# group: Wall Area
categories = Categories("OST_Walls")
all_elements_of_category = ElementsOfCategory(Category=categories)
string = StringInput("Area")
string_2 = StringInput("m²")
python_script = Python(IN[0]=all_elements_of_category, IN[1]=string, IN[2]=string_2)  # CPython3
# ---------- python_script.python (71 lines) ----------
import clr, math

# Revit API
clr.AddReference("RevitAPI")
from Autodesk.Revit.DB import *

# Dynamo services
clr.AddReference("RevitServices")
import RevitServices
from RevitServices.Persistence import DocumentManager

doc = DocumentManager.Instance.CurrentDBDocument
walls = [UnwrapElement(w) for w in IN[0]]

# Conversion
def ft2_to_m2(a): 
    return a * 0.09290304

# Revit directions
sectors = {
    "East": (0, 90),
    "North": (90, 180),
    "West": (180, 270),
    "South": (270, 360)
}

results = {s: 0.0 for s in sectors}
tolerance = 0.5  # degrees tolerance for boundaries

# Improved wall area getter
def get_wall_gross_area(wall):
    loc = wall.Location
    if not hasattr(loc, "Curve"):
        return 0.0
    length = loc.Curve.Length  # in ft

    # Try unconnected height first
    h_param = wall.get_Parameter(BuiltInParameter.WALL_USER_HEIGHT_PARAM)
    if h_param and h_param.StorageType == StorageType.Double:
        height = h_param.AsDouble()
    else:
        # Fallback: use wall type height
        wall_type_height_param = wall.WallType.get_Parameter(BuiltInParameter.WALL_HEIGHT_TYPE)
        height = wall_type_height_param.AsDouble() if wall_type_height_param else 0.0

    return length * height  # ft²

# Group walls by orientation
for w in walls:
    try:
        orientation = w.Orientation
        angle = round(math.degrees(math.atan2(orientation.Y, orientation.X)) % 360, 2)
        gross_area_ft2 = get_wall_gross_area(w)

        for name, (amin, amax) in sectors.items():
            if amin - tolerance <= angle < amax + tolerance:
                results[name] += gross_area_ft2
                break
    except:
        pass

# Convert to m² and round
for k in results:
    results[k] = round(ft2_to_m2(results[k]), 2)

# Automatically match opposite directions for symmetric buildings
# Average North/South and East/West areas
results["North"] = results["South"] = round((results["North"] + results["South"]) / 2, 2)
results["East"]  = results["West"]  = round((results["East"] + results["West"]) / 2, 2)

OUT = results
# ----------------------------------------
values = DesignScript.Builtin.Dictionary.Values(dictionary=python_script)

# group: uvalue wall
elementType = Element.ElementType(element=all_elements_of_category)
string_3 = StringInput("Heat Transfer Coefficient (U)")
getParameterValueByName = Element.GetParameterValueByName(element=elementType, parameterName=string_3)

# group: Curtain Panel Area
categories_2 = Categories("OST_CurtainWallPanels")
all_elements_of_category_2 = ElementsOfCategory(Category=categories_2)
string_4 = StringInput("Area")
string_5 = StringInput("m²")
python_script_2 = Python(IN[0]=all_elements_of_category_2, IN[1]=string_4, IN[2]=string_5)  # CPython3
# ---------- python_script_2.python (78 lines) ----------
import clr
import math

# --- Revit API references ---
clr.AddReference("RevitAPI")
from Autodesk.Revit.DB import *

# --- Dynamo to Revit ---
clr.AddReference("RevitServices")
import RevitServices
from RevitServices.Persistence import DocumentManager
from RevitServices.Transactions import TransactionManager

# Get current Revit document
doc = DocumentManager.Instance.CurrentDBDocument

# Unwrap input elements
windows = [UnwrapElement(w) for w in IN[0]]  # Windows from Dynamo input
paramName = IN[1]                             # e.g., "Area" or "Width"
units = IN[2] if len(IN) > 2 else "ft2"

# --- Helper functions ---
def ft2_to_m2(a): 
    return a * 0.09290304

# Define direction sectors
sectors = {
    "South": (0, 90),
    "North": (90, 180),
    "West": (180, 270),
    "East": (270, 360)
}

# Initialize results
results = {s: 0.0 for s in sectors}

def get_param_value(elem, pname):
    """Safely get a numeric parameter value"""
    p = elem.LookupParameter(pname)
    if p:
        try:
            return p.AsDouble()
        except:
            return 0.0
    return 0.0

# --- Main process ---
for win in windows:
    try:
        host = win.Host
        if not host or not hasattr(host, "Location"):
            continue
        loc = host.Location
        if not hasattr(loc, "Curve"):
            continue
        
        curve = loc.Curve
        p0 = curve.GetEndPoint(0)
        p1 = curve.GetEndPoint(1)
        vx = p1.X - p0.X
        vy = p1.Y - p0.Y
        angle = math.degrees(math.atan2(vy, vx)) % 360
        
        # Assign to direction sector
        for name, (amin, amax) in sectors.items():
            if amin <= angle < amax:
                results[name] += get_param_value(win, paramName)
                break
    except:
        pass

# Convert units if requested
if units.lower().startswith("m"):
    for k in results.keys():
        results[k] = ft2_to_m2(results[k])

# Output
OUT = results
# ----------------------------------------
values_2 = DesignScript.Builtin.Dictionary.Values(dictionary=python_script_2)

# group: Window Area
categories_3 = Categories("OST_Windows")
all_elements_of_category_3 = ElementsOfCategory(Category=categories_3)
string_6 = StringInput("Area")
string_7 = StringInput("m²")
python_script_3 = Python(IN[0]=all_elements_of_category_3, IN[1]=string_6, IN[2]=string_7)  # CPython3
# ---------- python_script_3.python (76 lines) ----------
import clr, math

# --- Revit API ---
clr.AddReference("RevitAPI")
from Autodesk.Revit.DB import *

# --- Dynamo Services ---
clr.AddReference("RevitServices")
import RevitServices
from RevitServices.Persistence import DocumentManager

doc = DocumentManager.Instance.CurrentDBDocument

# --- Inputs ---
windows = [UnwrapElement(w) for w in IN[0]]   # windows
paramName = IN[1]                             # e.g., "Area"
units = IN[2] if len(IN) > 2 else "ft2"

# --- Helper functions ---
def ft2_to_m2(a):
    return a * 0.09290304

def get_param_value(elem, pname):
    p = elem.LookupParameter(pname)
    if p and p.StorageType == StorageType.Double:
        try:
            return p.AsDouble()
        except:
            return 0.0
    return 0.0

# --- Directions ---
sectors = {
    "East": (0, 90),
    "North": (90, 180),
    "West": (180, 270),
    "South": (270, 360)
}

results = {s: 0.0 for s in sectors}
tolerance = 0.5  # degrees

# --- Main loop ---
for win in windows:
    try:
        host = getattr(win, "Host", None)
        if not host:
            continue  # skip if no host

        orientation = getattr(host, "Orientation", None)
        if not orientation:
            continue  # skip if host has no orientation

        angle = round(math.degrees(math.atan2(orientation.Y, orientation.X)) % 360, 2)
        area_ft2 = get_param_value(win, paramName)
        if area_ft2 == 0.0:
            continue

        for name, (amin, amax) in sectors.items():
            if amin - tolerance <= angle < amax + tolerance:
                results[name] += area_ft2
                break

    except:
        continue  # skip any problematic window

# --- Convert units ---
if units.lower().startswith("m"):
    for k in results.keys():
        results[k] = round(ft2_to_m2(results[k]), 2)

# --- Average opposite sides (optional) ---
results["North"] = results["South"] = round((results["North"] + results["South"]) / 2, 2)
results["East"]  = results["West"]  = round((results["East"] + results["West"]) / 2, 2)

OUT = results
# ----------------------------------------
values_3 = DesignScript.Builtin.Dictionary.Values(dictionary=python_script_3)

total_window_area = values_2 + values_3

# group: WWR
code_block = CodeBlock { 1; }
WWR = total_window_area / values
n1_wwr = code_block - WWR  # "1-WWR"

# group: Heat Conduction Through Wall
# Full Calculation Using Formula - 15×α×(1−WWR)×Uv
constant = CodeBlock { 15; }
a = CodeBlock { 0.15; }
mul = constant * a
n1_wwr_2 = mul * n1_wwr  # "* (1-WWR)"
wall_uv = getParameterValueByName * n1_wwr_2
wall_area = values * wall_uv

total_heat_conduction_walls = Math.Sum(values=wall_area)

# group: Heat Conduction Through Window
# Full Calculation Using Formula - 6 (WWR) Uf
code_block_2 = CodeBlock { 6; }
wwr = code_block_2 * WWR
insert_glass_u_value = DoubleSlider(5.7, range=0..100 step 0.1)  # graph input
total_window_area_2 = wwr * insert_glass_u_value
wall_area_2 = total_window_area_2 * values

heat_conduction_through_window = Math.Sum(values=wall_area_2)
add = total_heat_conduction_walls + heat_conduction_through_window

# group: Solar Heat Gain Through Windows
# Full Calculation Using Formula - 194×WWR×OF×SC
insert_glass_shading_coefficient = DoubleSlider(0.51, range=0..100 step 0.1)  # graph input
code_block_3 = CodeBlock { 194; }
wwr_2 = code_block_3 * WWR
sc = insert_glass_shading_coefficient * wwr_2
wall_area_3 = sc * values
west = CodeBlock { 0.94; }
north_cf = CodeBlock { 0.9; }
south_cf = CodeBlock { 0.92; }
east_cf = CodeBlock { 1.23; }
cf = List.Create(item0=west, item1=north_cf, item2=south_cf, item3=east_cf)
wwr_3 = wall_area_3 * cf

sum = Math.Sum(values=wwr_3)
add_2 = add + sum
sum_2 = Math.Sum(values=values)

# group: Total Wall Area
total_wall_area = Math.Sum(values=sum_2)

div = add_2 / total_wall_area

# group: Final Answer
answer_in_2_d_p = Python(IN[0]=div)  # CPython3; graph output
# ---------- answer_in_2_d_p.python (17 lines) ----------
import math

# Get input from Dynamo
data = IN[0]

# Function to round up to 2 decimal places
def round_up_2(x):
    try:
        return math.ceil(x * 100) / 100.0
    except:
        return None  # Handles invalid or null inputs

# Check if data is a list or single value
if isinstance(data, list):
    OUT = [round_up_2(i) for i in data if i is not None]
else:
    OUT = round_up_2(data)
# ----------------------------------------
answer_in_percentage = Python(IN[0]=div)  # CPython3; graph output
# ---------- answer_in_percentage.python (18 lines) ----------
import math

# Get input from Dynamo
data = IN[0]

# Function to round up to 2 decimal places and format with %
def round_up_2_to_percent(x):
    try:
        rounded = math.ceil(x * 100) / 100.0  # round up to 2 decimals
        return f"{rounded}%"  # add percentage sign without changing the value
    except:
        return None  # Handles invalid or null inputs

# Check if data is a list or single value
if isinstance(data, list):
    OUT = [round_up_2_to_percent(i) for i in data if i is not None]
else:
    OUT = round_up_2_to_percent(data)
# ----------------------------------------
